# Grasshopper definition 1 Math.gh (Grasshopper 1.0.7)

panel = Panel("""1
2
3
4
5
6
7
8
9
10""")

# ---- group: I'm also a Domain
panel_2 = Panel("0 to 1")

# ----
panel_3 = Panel("""3
7
2
6
7
2
4""")
panel_4 = Panel("""0.0
0.1
0.2
0.3
0.4
0.5
0.6
0.7
0.8
0.9
1.0""")
panel_5 = Panel("""1
2
3
4
5
6
7
8
9
10""")
construct_domain = ConstructDomain(DomainStart="3", DomainEnd="5.7")
number = Number(panel)
bounds = Bounds(Numbers=panel_3)
pi = Pi(Factor="0.5")
mass_addition = MassAddition(Input=panel_5)  # -> Result, PartialResults
square_root = SquareRoot(Value="2")
power_of_e = PowerOfE(Value="5")
cube = Cube(Value="3")
addition = Addition(A="1", B="2")
subtraction = Subtraction(A="1", B="2")
multiplication = Multiplication(A="3", B="2")
division = Division(A="1", B="2")
cosine = Cosine(Value="1")
average = Average(Input=number)
round = Round(Number=Slider(3.4, range=0..10))  # -> Nearest, Floor, Ceiling
remap_numbers = RemapNumbers(Value=panel_4, Source="0 to 1", Target="3 to 5")  # -> Mapped, Clipped
panel_6 = Panel(bounds)
panel_7 = Panel(pi)
deconstruct_domain = DeconstructDomain(Domain=construct_domain)  # -> Start, End
panel_8 = Panel(construct_domain)
panel_9 = Panel(square_root)
panel_10 = Panel(addition)
panel_11 = Panel(subtraction)
panel_12 = Panel(multiplication)
panel_13 = Panel(division)
panel_14 = Panel(power_of_e)
panel_15 = Panel(cube)

# ---- group: cos 1
panel_16 = Panel(cosine)

# ----
deconstruct_domain_2 = DeconstructDomain(Domain=bounds)  # -> Start, End
panel_17 = Panel(mass_addition.Result)
panel_18 = Panel(mass_addition.PartialResults)
panel_19 = Panel(round.Floor)
panel_20 = Panel(round.Nearest)
panel_21 = Panel(round.Ceiling)

# ---- group: Mean value
panel_22 = Panel(average)

# ----
panel_23 = Panel(remap_numbers.Mapped)
panel_24 = Panel(deconstruct_domain.End)
panel_25 = Panel(deconstruct_domain.Start)

# ---- group: The maximum
panel_26 = Panel(deconstruct_domain_2.Start)

# ---- group: The minimum
panel_27 = Panel(deconstruct_domain_2.End)
